# Grasshopper definition rhinoFlock.ghx (Grasshopper 0.9.56)

reset = BooleanToggle(True)
x_min = Slider(-492.248, range=-500..0)
x_max = Slider(425.197, range=0..500)
y_min = Slider(-456.977, range=-500..100)
y_max = Slider(396.654, range=0..500)
z_min = Slider(-279.07, range=-500..0)
z_max = Slider(250, range=0..500)
velocity_max = Slider(-15, range=-30..30)
velocity_min = Slider(15, range=-30..30)
maxforce = Slider(5, range=0..30)
maxspeed = Slider(18, range=0..30)
sepdist = Slider(53.55, range=0..200)
cohdist = Slider(30.349, range=0..200)
alidist = Slider(83.797, range=0..200)
numofagent = Slider(200, range=0..200)
numofagent_2 = Slider(182, range=0..200)
surface = Surface(<surface referenced from the Rhino model>)
velocity_min_2 = Slider(15, range=-30..30)
maxspeed_2 = Slider(18, range=0..30)
cohdist_2 = Slider(30.349, range=0..200)
alidist_2 = Slider(83.797, range=0..200)
numofagent_3 = Slider(64, range=0..200)
velocity_max_2 = Slider(-15, range=-30..30)
maxforce_2 = Slider(5, range=0..30)
sepdist_2 = Slider(53.55, range=0..200)
surface_2 = Surface(<surface referenced from the Rhino model>)
timer = Timer(TimerInterval=20, Target=c_script)  # disabled
timer_2 = Timer(TimerInterval=20, Target=rhinoflock_c)  # disabled
reset_2 = Button(ExpressionNormal="true", ExpressionPressed="false")
timer_3 = Timer(TimerInterval=20, Target=c_script_2)  # disabled
reset_3 = Button(ExpressionNormal="true", ExpressionPressed="false")
c_script = CSharpScript(
    reset=reset,
    x1=x_min,
    x2=x_max,
    y1=y_min,
    y2=y_max,
    z1=z_min,
    z2=z_max,
    velocity_max=velocity_max,
    velocity_min=velocity_min,
    maxForce=maxforce,
    maxSpeed=maxspeed,
    sepDist=sepdist,
    cohDist=cohdist,
    aliDist=alidist,
    numPts=numofagent)  # -> out, Pos, box_firstCorner, box_secondCorner, A; inputs reset: Boolean, x1: Int32, x2: Int32, y1: Int32, y2: Int32, z1: Int32, z2: Int32, velocity_max: Double, velocity_min: Double, maxForce: Double, maxSpeed: Double, sepDist: Double, cohDist: Double, aliDist: Double, numPts: Int32
# ---------- c_script: C# ----------
    //S.I BETA 0.1
    //The base methods, separate, align, cohesion, and seek, are
    //from Daniel Shiffman and expanded by Shih-Yuan Wang

    if(reset == false){
      //empty the list
      agentCollection.Clear();
      position.Clear();
      
      //make new points
      Random rnd = new Random();
      for(int i = 0; i < numPts; i++){
        double velX = (velocity_max - (velocity_min)) * rnd.NextDouble() + (velocity_min);
        double velY = (velocity_max - (velocity_min)) * rnd.NextDouble() + (velocity_min);
        double velZ = (velocity_max - (velocity_min)) * rnd.NextDouble() + (velocity_min);
        Agent ag = new Agent(new Vector3d(rnd.Next(-500, 500), rnd.Next(-500, 500), rnd.Next(-500, 500)),
          new Vector3d(velX, velY, velZ), x1, x2, y1, y2, z1, z2, maxForce, maxSpeed, sepDist, cohDist, aliDist);
        agentCollection.Add(ag);
      }
      
      //draw a box
      box_firstCorner = new Point3d(x1, y1, z1);
      box_secondCorner = new Point3d(x2, y2, z2);

    }else{

      //draw a box
      box_firstCorner = new Point3d(x1, y1, z1);
      box_secondCorner = new Point3d(x2, y2, z2);

      //output for position points
      List<Point3d> pts = new List<Point3d>();

      
      for(int i = 0; i < agentCollection.Count; i++){
        Agent getAgent = agentCollection[i] as Agent;
        getAgent.setMaxSpeed(maxSpeed);
        getAgent.setMin_x(x1);
        getAgent.setMax_x(x2);
        getAgent.setMin_y(y1);
        getAgent.setMax_y(y2);
        getAgent.setMin_z(z1);
        getAgent.setMax_z(z2);
        getAgent.setMaxForce(maxForce);
        getAgent.setSepDist(sepDist);
        getAgent.setCohDist(cohDist);
        getAgent.setAliDist(aliDist);
        getAgent.run(agentCollection);
        pts.Add(new Point3d(getAgent.location.X, getAgent.location.Y, getAgent.location.Z));
      }

      Pos = pts;

    }
    //////////////////////////////////////////////////////////////////////////
    //////////////////////////////////////////////////////////////////////////
# ---------- c_script: C# additional code ----------
  class Agent{

    //////////////////////////////////////////////////////////////////////////
    //PROPERTIES
    //////////////////////////////////////////////////////////////////////////
    public Vector3d location = new Vector3d(0, 0, 0);
    public Vector3d velocity = new Vector3d(0, 0, 0);
    public Vector3d acceleration = new Vector3d(0, 0, 0);
    public double max_x;
    public double min_x;
    public double max_y;
    public double min_y;
    public double max_z;
    public double min_z;
    public double maxForce;
    public double sepDist;
    public double cohDist;
    public double aliDist;
    public double maxSpeed;

    //////////////////////////////////////////////////////////////////////////
    //CONSTRUCTOR
    //////////////////////////////////////////////////////////////////////////
    public Agent(Vector3d location, Vector3d velocity, double min_x, double max_x, double min_y, double max_y,
    double min_z, double max_z, double maxForce, double maxSpeed, double sepDist, double cohDist, double aliDist){

      this.location = location;
      this.velocity = velocity;
      this.max_x = max_x;
      this.min_x = min_x;
      this.max_y = max_y;
      this.min_y = min_y;
      this.max_z = max_z;
      this.min_z = min_z;
      this.maxForce = maxForce;
      this.maxSpeed = maxSpeed;
      this.sepDist = sepDist;
      this.cohDist = cohDist;
      this.aliDist = aliDist;

    }

    //////////////////////////////////////////////////////////////////////////
    //METHOD
    //////////////////////////////////////////////////////////////////////////
    public void run(List<Agent> agentCollection){

      flock(agentCollection);
      checkBorder();
      update();
    }

    public void update(){

      velocity = Vector3d.Add(velocity, acceleration);
      if(velocity.Length > maxSpeed){

        velocity.Unitize();
        velocity *= maxSpeed;
      }
      location = Vector3d.Add(location, velocity);
      acceleration *= 0;
    }

    public void flock(List<Agent> agentCollection){

      Vector3d sep = seprate(agentCollection);
      Vector3d ali = align(agentCollection);
      Vector3d coh = cohesion(agentCollection);
      sep = Vector3d.Multiply(sep, 1.5);
      ali = Vector3d.Multiply(ali, 1);
      coh = Vector3d.Multiply(coh, 1);
      acceleration = Vector3d.Add(acceleration, sep);
      acceleration = Vector3d.Add(acceleration, ali);
      acceleration = Vector3d.Add(acceleration, coh);

    }

    public Vector3d seprate(List<Agent> agentCollection){

      double desiredseparation = sepDist;
      Vector3d steer = new Vector3d(0, 0, 0);
      int count = 0;
      for(int i = 0; i < agentCollection.Count; i++){

        Agent other = agentCollection[i] as Agent;
        Point3d loc = new Point3d(other.location.X, other.location.Y, other.location.Z);
        double d = loc.DistanceTo(new Point3d(location.X, location.Y, location.Z));

        if((d > 0) && ( d < desiredseparation)){

          Vector3d diff = Vector3d.Subtract(location, other.location);
          diff.Unitize();
          Vector3d dic = Vector3d.Divide(diff, d);
          steer = Vector3d.Add(steer, dic);
          count++;
        }
      }
      if(count > 0) steer = Vector3d.Divide(steer, (double) count);
      if(steer.Length > 0){

        steer.Unitize();
        steer *= maxSpeed;
        steer = Vector3d.Subtract(steer, velocity);
        if(steer.Length > maxForce){

          steer.Unitize();
          steer *= maxForce;
        }
      }
      return steer;
    }

    public Vector3d align(List<Agent> agentCollection){

      double neighbordist = aliDist;
      Vector3d steer = new Vector3d(0, 0, 0);
      int count = 0;
      for(int i = 0; i < agentCollection.Count; i++){

        Agent other = agentCollection[i] as Agent;
        Point3d loc = new Point3d(other.location.X, other.location.Y, other.location.Z);
        double d = loc.DistanceTo(new Point3d(location.X, location.Y, location.Z));
        if((d > 0) && ( d < neighbordist)){

          steer = Vector3d.Add(steer, other.velocity);
          count++;
        }
      }
      if(count > 0) steer = Vector3d.Divide(steer, (double) count);
      if(steer.Length > 0){

        steer.Unitize();
        steer *= maxSpeed;
        steer = Vector3d.Subtract(steer, velocity);
        if(steer.Length > maxForce){

          steer.Unitize();
          steer *= maxForce;
        }
      }
      return steer;
    }

    public Vector3d steer(Vector3d target, bool slowdown){

      Vector3d steer;
      Vector3d desired = Vector3d.Subtract(target, location);
      double d = desired.Length;

      if(d > 0){

        desired.Unitize();
        if((slowdown) && (d < 100)){
          desired *= maxSpeed * (d / 100);

        }else{
          desired *= maxSpeed;
        }
        steer = Vector3d.Subtract(desired, velocity);
        if(steer.Length > maxForce){
          steer.Unitize();
          steer *= maxForce;
        }
      }else{
        steer = new Vector3d(0, 0, 0);
      }
      return steer;
    }

    public Vector3d cohesion(List<Agent> agentCollection){

      double neighbordist = cohDist;
      Vector3d sum = new Vector3d(0, 0, 0);
      int count = 0;
      for(int i = 0; i < agentCollection.Count; i++){

        Agent other = agentCollection[i] as Agent;
        Point3d loc = new Point3d(other.location.X, other.location.Y, other.location.Z);
        double d = loc.DistanceTo(new Point3d(location.X, location.Y, location.Z));
        if((d > 0) && ( d < neighbordist)){

          sum = Vector3d.Add(sum, other.location);
          count++;
        }
      }
      if(count > 0){

        sum = Vector3d.Divide(sum, (double) count);
        return steer(sum, false);
      }
      return sum;
    }

    public Vector3d getPos(){

      return location;
    }

    public void checkBorder(){

      if(location.X < min_x) velocity.X = 2;
      if(location.Y < min_y) velocity.Y = 2;
      if(location.Z < min_z) velocity.Z = 2;
      if(location.X > max_x) velocity.X = -2;
      if(location.Y > max_y) velocity.Y = -2;
      if(location.Z > max_z) velocity.Z = -2;
    }

    public void setMin_x(double min_x){

      this.min_x = min_x;
    }
    public void setMax_x(double max_x){

      this.max_x = max_x;
    }
    public void setMin_y(double min_y){

      this.min_y = min_y;
    }
    public void setMax_y(double max_y){
      this.max_y = max_y;
    }
    public void setMin_z(double min_z){

      this.min_z = min_z;
    }
    public void setMax_z(double max_z){
      this.max_z = max_z;
    }
    public void setMaxSpeed(double maxSpeed){

      this.maxSpeed = maxSpeed;
    }
    public void setMaxForce(double maxForce){
      this.maxForce = maxForce;
    }
    public void setSepDist(double sepDist){
      this.sepDist = sepDist;
    }
    public void setCohDist(double cohDist){
      this.cohDist = cohDist;
    }
    public void setAliDist(double aliDist){
      this.aliDist = aliDist;
    }
  }

  List<Agent> agentCollection = new List<Agent>();
  List<Vector3d> position = new List<Vector3d>();
# ---------- end c_script ----------
rhinoflock_c = CSharpScript(numPts=numofagent_2, reset=reset_2)  # -> out, Pos, A, B; inputs numPts: Int32, controlSurface: Surface, reset: Boolean
# ---------- rhinoflock_c: C# ----------
    double velocity_max = 15;
    double velocity_min = -15;
    double maxForce = 5;
    double maxSpeed = 18;
    double sepDist = 50;
    double cohDist = 30;
    double aliDist = 80;
    string agentPrint = "1";

    if(reset == false){
      //empty the list
      agentCollection.Clear();
      position.Clear();

      //make new points
      Random rnd = new Random();
      for(int i = 0; i < numPts; i++){
        double velX = (velocity_max - (velocity_min)) * rnd.NextDouble() + (velocity_min);
        double velY = (velocity_max - (velocity_min)) * rnd.NextDouble() + (velocity_min);
        double velZ = (velocity_max - (velocity_min)) * rnd.NextDouble() + (velocity_min);
        //Agent constructor (location, velocity, maxForce, double maxSpeed, double sepDist, double cohDist, double aliDist
        Agent ag = new Agent(
          new Vector3d(rnd.Next(-500, 500), rnd.Next(-500, 500), rnd.Next(-500, 500)),
          new Vector3d(velX, velY, velZ),
          maxForce, maxSpeed, sepDist, cohDist, aliDist);
        agentCollection.Add(ag);
      }
    }else{

      //make a list for position points
      List<Point3d> pts = new List<Point3d>();


      //200 times
      for(int i = 0; i < agentCollection.Count; i++){
        //set all the properties
        Agent currentAgent = agentCollection[i] as Agent;
        currentAgent.setMaxSpeed(maxSpeed);
        currentAgent.setMaxForce(maxForce);
        currentAgent.setSepDist(sepDist);
        currentAgent.setCohDist(cohDist);
        currentAgent.setAliDist(aliDist);
        //currentAgent.setControlSurface(controlSurface);
        //run
        currentAgent.run(agentCollection);
        //output
        pts.Add(new Point3d(currentAgent.location.X, currentAgent.location.Y, currentAgent.location.Z));
      }

      Pos = pts;
      A = agentPrint;
    }
    //////////////////////////////////////////////////////////////////////////


    //////////////////////////////////////////////////////////////////////////
# ---------- rhinoflock_c: C# additional code ----------
  class Agent{

    //////////////////////////////////////////////////////////////////////////
    //PROPERTIES
    //////////////////////////////////////////////////////////////////////////
    public Vector3d location = new Vector3d(0, 0, 0);
    public Vector3d velocity = new Vector3d(0, 0, 0);
    public Vector3d acceleration = new Vector3d(0, 0, 0);
    public double maxForce;
    public double sepDist;
    public double cohDist;
    public double aliDist;
    public double maxSpeed;
    public string print;


    //internal variables
    private Rhino.Geometry.Surface controlSrf;
    private Point3d closestPt = new Point3d(0, 0, 0);
    private Point3d testPoint = new Point3d(0, 0, 0);
    private double doubleU = 0;
    private double doubleV = 0;
    private double distance = 0;

    //////////////////////////////////////////////////////////////////////////
    //CONSTRUCTOR
    //////////////////////////////////////////////////////////////////////////
    public Agent(Vector3d location, Vector3d velocity, double maxForce, double maxSpeed, double sepDist, double cohDist, double aliDist){

      this.location = location;
      this.velocity = velocity;
      this.maxForce = maxForce;
      this.maxSpeed = maxSpeed;
      this.sepDist = sepDist;
      this.cohDist = cohDist;
      this.aliDist = aliDist;
      this.distance = 0;
      this.print = "0";

    }

    //////////////////////////////////////////////////////////////////////////
    //METHODS
    //////////////////////////////////////////////////////////////////////////
    public void run(List<Agent> agentCollection){
      //flock(agentCollection);
      //acceleration is the thing that changes
      Vector3d sep = seprate(agentCollection);
      Vector3d ali = align(agentCollection);
      Vector3d coh = cohesion(agentCollection);
      sep = Vector3d.Multiply(sep, 1.5);
      ali = Vector3d.Multiply(ali, 1);
      coh = Vector3d.Multiply(coh, 1);
      acceleration = Vector3d.Add(acceleration, sep);
      acceleration = Vector3d.Add(acceleration, ali);
      acceleration = Vector3d.Add(acceleration, coh);

      checkBorder();
      update();
    }

    public void checkBorder(){

      //calculate distance to control Surface
      //closestPt = x.CurvatureAt(u, v);
      //testPoint = new Point3d(this.location);
      //controlSrf.ClosestPoint(testPoint, out doubleU, out doubleV);
      //closestPt = controlSrf.PointAt(doubleU, doubleV);
      //distance = testPoint.DistanceTo(closestPt);
      //
      //if (distance > 20){
      //  location = new Vector3d(testPoint);
      //}

      //if (distance < 10) velocity = -velocity;
      if(location.X < -1000) velocity.X = 2;
      if(location.Y < -1000) velocity.Y = 2;
      if(location.Z < -1000) velocity.Z = 2;
      if(location.X > 1000) velocity.X = -2;
      if(location.Y > 1000) velocity.Y = -2;
      if(location.Z > 1000) velocity.Z = -2;
    }





    public void update(){

      velocity = Vector3d.Add(velocity, acceleration);
      if(velocity.Length > maxSpeed){

        velocity.Unitize();
        velocity *= maxSpeed;
      }
      location = Vector3d.Add(location, velocity);
      acceleration *= 0;
    }

    public Vector3d seprate(List < Agent > agentCollection){

      double desiredseparation = sepDist;
      Vector3d steer = new Vector3d(0, 0, 0);
      int count = 0;
      for(int i = 0; i < agentCollection.Count; i++){

        Agent other = agentCollection[i] as Agent;
        Point3d loc = new Point3d(other.location.X, other.location.Y, other.location.Z);
        double d = loc.DistanceTo(new Point3d(location.X, location.Y, location.Z));

        if((d > 0) && ( d < desiredseparation)){

          Vector3d diff = Vector3d.Subtract(location, other.location);
          diff.Unitize();
          Vector3d dic = Vector3d.Divide(diff, d);
          steer = Vector3d.Add(steer, dic);
          count++;
        }
      }
      if(count > 0) steer = Vector3d.Divide(steer, (double) count);
      if(steer.Length > 0){

        steer.Unitize();
        steer *= maxSpeed;
        steer = Vector3d.Subtract(steer, velocity);
        if(steer.Length > maxForce){

          steer.Unitize();
          steer *= maxForce;
        }
      }
      return steer;
    }
    public Vector3d align(List < Agent > agentCollection){

      double neighbordist = aliDist;
      Vector3d steer = new Vector3d(0, 0, 0);
      int count = 0;
      for(int i = 0; i < agentCollection.Count; i++){

        Agent other = agentCollection[i] as Agent;
        Point3d loc = new Point3d(other.location.X, other.location.Y, other.location.Z);
        double d = loc.DistanceTo(new Point3d(location.X, location.Y, location.Z));
        if((d > 0) && ( d < neighbordist)){

          steer = Vector3d.Add(steer, other.velocity);
          count++;
        }
      }
      if(count > 0) steer = Vector3d.Divide(steer, (double) count);
      if(steer.Length > 0){

        steer.Unitize();
        steer *= maxSpeed;
        steer = Vector3d.Subtract(steer, velocity);
        if(steer.Length > maxForce){

          steer.Unitize();
          steer *= maxForce;
        }
      }
      return steer;
    }
    public Vector3d steer(Vector3d target, bool slowdown){

      Vector3d steer;
      Vector3d desired = Vector3d.Subtract(target, location);
      double d = desired.Length;

      if(d > 0){

        desired.Unitize();
        if((slowdown) && (d < 100)){
          desired *= maxSpeed * (d / 100);

        }else{
          desired *= maxSpeed;
        }
        steer = Vector3d.Subtract(desired, velocity);
        if(steer.Length > maxForce){
          steer.Unitize();
          steer *= maxForce;
        }
      }else{
        steer = new Vector3d(0, 0, 0);
      }
      return steer;
    }
    public Vector3d cohesion(List < Agent > agentCollection){

      double neighbordist = cohDist;
      Vector3d sum = new Vector3d(0, 0, 0);
      int count = 0;
      for(int i = 0; i < agentCollection.Count; i++){

        Agent other = agentCollection[i] as Agent;
        Point3d loc = new Point3d(other.location.X, other.location.Y, other.location.Z);
        double d = loc.DistanceTo(new Point3d(location.X, location.Y, location.Z));
        if((d > 0) && ( d < neighbordist)){

          sum = Vector3d.Add(sum, other.location);
          count++;
        }
      }
      if(count > 0){

        sum = Vector3d.Divide(sum, (double) count);
        return steer(sum, false);
      }
      return sum;
    }
    public double getDistance(){
      return distance;
    }
    public Vector3d getPos(){

      return location;
    }

    public void setMaxSpeed(double maxSpeed){

      this.maxSpeed = maxSpeed;
    }
    public void setMaxForce(double maxForce){
      this.maxForce = maxForce;
    }
    public void setSepDist(double sepDist){
      this.sepDist = sepDist;
    }
    public void setCohDist(double cohDist){
      this.cohDist = cohDist;
    }
    public void setAliDist(double aliDist){
      this.aliDist = aliDist;
    }
    //public void setControlSurface(Surface controlSurface){
    //   this.controlSrf = controlSurface;
    // }
  }

  List<Agent> agentCollection = new List<Agent>();
  List<Vector3d> position = new List<Vector3d>();



  //S.I BETA 0.1
  //The base methods, separate, align, cohesion, and seek, are
  //from Daniel Shiffman and expanded by Shih-Yuan Wang
# ---------- end rhinoflock_c ----------
c_script_2 = CSharpScript(
    velocity_max=velocity_max_2,
    velocity_min=velocity_min_2,
    maxForce=maxforce_2,
    maxSpeed=maxspeed_2,
    sepDist=sepdist_2,
    cohDist=cohdist_2,
    aliDist=alidist_2,
    numPts=numofagent_3,
    controlSurface=surface_2,
    reset=reset_3)  # -> out, Pos, A, B; inputs velocity_max: Double, velocity_min: Double, maxForce: Double, maxSpeed: Double, sepDist: Double, cohDist: Double, aliDist: Double, numPts: Int32, controlSurface: Surface, reset: Boolean
# ---------- c_script_2: C# ----------
    if(reset == false){
      //empty the list
      agentCollection.Clear();
      position.Clear();

      //make new points
      Random rnd = new Random();
      for(int i = 0; i < numPts; i++){
        double velX = (velocity_max - (velocity_min)) * rnd.NextDouble() + (velocity_min);
        double velY = (velocity_max - (velocity_min)) * rnd.NextDouble() + (velocity_min);
        double velZ = (velocity_max - (velocity_min)) * rnd.NextDouble() + (velocity_min);
        //Agent constructor (location, velocity, maxForce, double maxSpeed, double sepDist, double cohDist, double aliDist
        Agent ag = new Agent(
          new Vector3d(rnd.Next(-500, 500), rnd.Next(-500, 500), rnd.Next(-500, 500)),
          new Vector3d(velX, velY, velZ),
          maxForce, maxSpeed, sepDist, cohDist, aliDist);
        agentCollection.Add(ag);
      }
    }else{

      //make a list for position points
      List<Point3d> pts = new List<Point3d>();


      //200 times
      for(int i = 0; i < agentCollection.Count; i++){
        //set all the properties
        Agent currentAgent = agentCollection[i] as Agent;
        currentAgent.setMaxSpeed(maxSpeed);
        currentAgent.setMaxForce(maxForce);
        currentAgent.setSepDist(sepDist);
        currentAgent.setCohDist(cohDist);
        currentAgent.setAliDist(aliDist);
        currentAgent.setControlSurface(controlSurface);
        //run
        currentAgent.run(agentCollection);
        //output
        pts.Add(new Point3d(currentAgent.location.X, currentAgent.location.Y, currentAgent.location.Z));
      }

      Pos = pts;

    }
    //////////////////////////////////////////////////////////////////////////


    //////////////////////////////////////////////////////////////////////////
# ---------- c_script_2: C# additional code ----------
  class Agent{

    //////////////////////////////////////////////////////////////////////////
    //PROPERTIES
    //////////////////////////////////////////////////////////////////////////
    public Vector3d location = new Vector3d(0, 0, 0);
    public Vector3d velocity = new Vector3d(0, 0, 0);
    public Vector3d acceleration = new Vector3d(0, 0, 0);
    public double maxForce;
    public double sepDist;
    public double cohDist;
    public double aliDist;
    public double maxSpeed;



    //internal variables
    private Rhino.Geometry.Surface controlSrf;
    private Point3d closestPt = new Point3d(0, 0, 0);
    private Point3d testPoint = new Point3d(0, 0, 0);
    private double doubleU = 0;
    private double doubleV = 0;
    private double distance = 0;

    //////////////////////////////////////////////////////////////////////////
    //CONSTRUCTOR
    //////////////////////////////////////////////////////////////////////////
    public Agent(Vector3d location, Vector3d velocity, double maxForce, double maxSpeed, double sepDist, double cohDist, double aliDist){

      this.location = location;
      this.velocity = velocity;
      this.maxForce = maxForce;
      this.maxSpeed = maxSpeed;
      this.sepDist = sepDist;
      this.cohDist = cohDist;
      this.aliDist = aliDist;
      this.distance = 0;

    }

    //////////////////////////////////////////////////////////////////////////
    //METHOD
    //////////////////////////////////////////////////////////////////////////
    public void run(List < Agent > agentCollection){

      flock(agentCollection);
      checkBorder();
      update();
    }
    public void flock(List<Agent> agentCollection){
      Vector3d sep = seprate(agentCollection);
      Vector3d ali = align(agentCollection);
      Vector3d coh = cohesion(agentCollection);
      sep = Vector3d.Multiply(sep, 1.5);
      ali = Vector3d.Multiply(ali, 1);
      coh = Vector3d.Multiply(coh, 1);
      acceleration = Vector3d.Add(acceleration, sep);
      acceleration = Vector3d.Add(acceleration, ali);
      acceleration = Vector3d.Add(acceleration, coh);
    }
    
    
    
    
    public void checkBorder(){

      //calculate distance to control Surface
      //closestPt = x.CurvatureAt(u, v);
      controlSrf.ClosestPoint(testPoint, out doubleU, out doubleV);
      closestPt = controlSrf.PointAt(doubleU, doubleV);
      distance = testPoint.DistanceTo(closestPt);

      //if (distance < 10) velocity = -velocity;
      if(location.X < -1000) velocity.X = 2;
      if(location.Y < -1000) velocity.Y = 2;
      if(location.Z < -100) velocity.Z = 2;
      if(location.X > 1000) velocity.X = -2;
      if(location.Y > 1000) velocity.Y = -2;
      if(location.Z > 100) velocity.Z = -2;
    }
    
    
    
    
    
    public void update(){

      velocity = Vector3d.Add(velocity, acceleration);
      if(velocity.Length > maxSpeed){

        velocity.Unitize();
        velocity *= maxSpeed;
      }
      location = Vector3d.Add(location, velocity);
      acceleration *= 0;
    }

    public Vector3d seprate(List < Agent > agentCollection){

      double desiredseparation = sepDist;
      Vector3d steer = new Vector3d(0, 0, 0);
      int count = 0;
      for(int i = 0; i < agentCollection.Count; i++){

        Agent other = agentCollection[i] as Agent;
        Point3d loc = new Point3d(other.location.X, other.location.Y, other.location.Z);
        double d = loc.DistanceTo(new Point3d(location.X, location.Y, location.Z));

        if((d > 0) && ( d < desiredseparation)){

          Vector3d diff = Vector3d.Subtract(location, other.location);
          diff.Unitize();
          Vector3d dic = Vector3d.Divide(diff, d);
          steer = Vector3d.Add(steer, dic);
          count++;
        }
      }
      if(count > 0) steer = Vector3d.Divide(steer, (double) count);
      if(steer.Length > 0){

        steer.Unitize();
        steer *= maxSpeed;
        steer = Vector3d.Subtract(steer, velocity);
        if(steer.Length > maxForce){

          steer.Unitize();
          steer *= maxForce;
        }
      }
      return steer;
    }
    public Vector3d align(List < Agent > agentCollection){

      double neighbordist = aliDist;
      Vector3d steer = new Vector3d(0, 0, 0);
      int count = 0;
      for(int i = 0; i < agentCollection.Count; i++){

        Agent other = agentCollection[i] as Agent;
        Point3d loc = new Point3d(other.location.X, other.location.Y, other.location.Z);
        double d = loc.DistanceTo(new Point3d(location.X, location.Y, location.Z));
        if((d > 0) && ( d < neighbordist)){

          steer = Vector3d.Add(steer, other.velocity);
          count++;
        }
      }
      if(count > 0) steer = Vector3d.Divide(steer, (double) count);
      if(steer.Length > 0){

        steer.Unitize();
        steer *= maxSpeed;
        steer = Vector3d.Subtract(steer, velocity);
        if(steer.Length > maxForce){

          steer.Unitize();
          steer *= maxForce;
        }
      }
      return steer;
    }
    public Vector3d steer(Vector3d target, bool slowdown){

      Vector3d steer;
      Vector3d desired = Vector3d.Subtract(target, location);
      double d = desired.Length;

      if(d > 0){

        desired.Unitize();
        if((slowdown) && (d < 100)){
          desired *= maxSpeed * (d / 100);

        }else{
          desired *= maxSpeed;
        }
        steer = Vector3d.Subtract(desired, velocity);
        if(steer.Length > maxForce){
          steer.Unitize();
          steer *= maxForce;
        }
      }else{
        steer = new Vector3d(0, 0, 0);
      }
      return steer;
    }
    public Vector3d cohesion(List < Agent > agentCollection){

      double neighbordist = cohDist;
      Vector3d sum = new Vector3d(0, 0, 0);
      int count = 0;
      for(int i = 0; i < agentCollection.Count; i++){

        Agent other = agentCollection[i] as Agent;
        Point3d loc = new Point3d(other.location.X, other.location.Y, other.location.Z);
        double d = loc.DistanceTo(new Point3d(location.X, location.Y, location.Z));
        if((d > 0) && ( d < neighbordist)){

          sum = Vector3d.Add(sum, other.location);
          count++;
        }
      }
      if(count > 0){

        sum = Vector3d.Divide(sum, (double) count);
        return steer(sum, false);
      }
      return sum;
    }
    public double getDistance(){
      return distance;
    }
    public Vector3d getPos(){

      return location;
    }

    public void setMaxSpeed(double maxSpeed){

      this.maxSpeed = maxSpeed;
    }
    public void setMaxForce(double maxForce){
      this.maxForce = maxForce;
    }
    public void setSepDist(double sepDist){
      this.sepDist = sepDist;
    }
    public void setCohDist(double cohDist){
      this.cohDist = cohDist;
    }
    public void setAliDist(double aliDist){
      this.aliDist = aliDist;
    }
    public void setControlSurface(Surface controlSurface){
      this.controlSrf = controlSurface;
    }
  }

  List<Agent> agentCollection = new List<Agent>();
  List<Vector3d> position = new List<Vector3d>();



  //S.I BETA 0.1
  //The base methods, separate, align, cohesion, and seek, are
  //from Daniel Shiffman and expanded by Shih-Yuan Wang
# ---------- end c_script_2 ----------
point = Point(<point referenced from the Rhino model>)
surface_3 = Surface(<surface referenced from the Rhino model>)
point_2 = Point(<point referenced from the Rhino model>)
surface_4 = Surface(<surface referenced from the Rhino model>)
panel = Panel(c_script.out)
box_2pt = Box2Pt(PointA=c_script.box_firstCorner, PointB=c_script.box_secondCorner, Plane=PlaneXY(0, 0, 0))
point_3 = Point(c_script.Pos)
point_4 = Point(rhinoflock_c.Pos)
panel_2 = Panel(rhinoflock_c.A)
panel_3 = Panel(rhinoflock_c.out)
point_5 = Point(c_script_2.Pos)
panel_4 = Panel(c_script_2.A)
panel_5 = Panel(c_script_2.out)
closest_point_c = CSharpScript(controlSrf=surface_3, testPoint=point)  # -> out, A, B; inputs controlSrf: Surface, testPoint: Point3d
# ---------- closest_point_c: C# ----------
    Point3d closestPt = new Point3d();
    double doubleU = 0;
    double doubleV = 0;
    double distance = 0;

    //closestPt = x.CurvatureAt(u, v);
    controlSrf.ClosestPoint(testPoint, out doubleU, out doubleV);
    closestPt = controlSrf.PointAt(doubleU, doubleV);
    distance = testPoint.DistanceTo(closestPt);

    A = distance;
    B = closestPt;
# ---------- end closest_point_c ----------
closest_point_c_2 = CSharpScript(controlSrf=surface_4, testPoint=point_2)  # -> out, A, B; inputs controlSrf: Surface, testPoint: Point3d; same code as closest_point_c
panel_6 = Panel(closest_point_c.out)
panel_7 = Panel(closest_point_c.A)
panel_8 = Panel(closest_point_c_2.out)
panel_9 = Panel(closest_point_c_2.A)
